# Grasshopper definition ShearConnection.gh (Grasshopper 1.0.7)
# plug-ins: Beaver

a1v = Slider(0.08, range=0..0.1)
npar = Slider(3, range=0..10)
nperp = Slider(3, range=0..10)
a1h = Slider(0.08, range=0..0.1)
bmat = Material(
    Name="GL24c",
    Type="Glulam",
    BendingResistance=24,
    ParallelTensionResistence=17,
    PerpendicularTensionResistence=0.5,
    PalallelCompressionResistence=21.5,
    PerpendicularCompressionResistence=2.5,
    ShearResistence=3.5,
    MeanModulusOfElasticityParallel=11000,
    _5ModulusOfElasticityParallel=9100,
    MeanModulusOfElasticityPerpendicular=300,
    MeanModulusOfElasticityShear=650,
    _5ModulusOfElasticityShear=540)
pt = Point(Point(0, 0, 0))
number_slider = Slider(10, range=0..10)
type = ValueList({"Dowel", "Screw", "Bolt", "Nail"}, selected="Screw")
type_2 = ValueList({"Rectangular": "rectangular", "Circular": "circular"}, selected="Rectangular")
type_3 = ValueList({"Rectangular": "rectangular", "Circular": "circular"}, selected="Rectangular")
arrange_fast = ARRANGEFAST(G=pt, N=a1v, C=npar, N_2=a1h, C_2=nperp)
fast = Fastener(
    FastenerType=type,
    NominalDiameter=Slider(6.1, range=0..12),
    ShankDiameter=Slider(8, range=0..12),
    HeadDiameter=Slider(8, range=0..12),
    FastenerLength=Slider(50, range=0..150),
    SmoothBoolean=False,
    FastenerFu=400)
force = Force(
    NormalForce=Slider(1, range=-5..5),
    ShearForceY=Slider(-1, range=-5..5),
    ShearForceZ=Slider(0, range=-5..5),
    TorsionalMoment=Slider(0, range=-5..5),
    BendingMomentY=Slider(2, range=-5..5),
    BendingMomentZ=Slider(0, range=-5..5),
    LoadCaseType="P")
disp = Comp_Displacement(DisplacementX=0, DisplacementY=0, DisplacementZ=0, LoadCaseType="P")
cs = CrossSection(Type=type_3, Material=bmat, Height=number_slider, Width=number_slider)
xz = XZPlane(Origin=Point(0, 0, 0))
spacings = ShearConnectionSpacings(Npar=npar, Nperp=nperp, Stagger=False, A1=a1v, A2=a1v, A3=a1v, A4=a1v, Plane=xz)
framepoint = TimberFramePoint(
    CrossSection=cs,
    Forces=force,
    DisplacementVector=disp,
    BucklingLenghtY=3,
    BucklingLenghtZ=3,
    SpanLenght=3,
    PreCamber=0,
    Cantilever=False,
    SpanLimitRange=0.5,
    ServiceClass="2")
t2t = TimberToTimberConnection(
    Fastener=fast,
    PreDrilled1="true",
    PreDrilled2="true",
    Alpha1="0",
    Alpha2="90",
    T1="15",
    T2="15",
    Mat1=bmat,
    Mat2=bmat,
    ShearPlanes="1",
    RopeEffect="true")  # -> FastenerCapacity, Fastener, ShearCapacities, AxialCapacities
list = ValueList({"N", "Vz", "Vy", "Shear", "Axial", "Combined"}, selected="Combined")
list_2 = ValueList({"Faxd", "Fvd", "Fx", "Fy", "Fz", "Fi_My", "Fi_Mt"}, selected="Fvd")
capacities = Panel(t2t.ShearCapacities)
semirigidconnection = SemiRigidConnection(
    Plane=xz,
    Points=arrange_fast,
    Fastener=t2t.Fastener,
    Spacing=spacings,
    TimberFramePoint=framepoint,
    ForceType=list_2,
    AnalysisType=list)  # -> Points, Vector, Value, Utilization, Mesh
scale = Slider(40, range=0..100)
vlen = VectorLength(Vector=semirigidconnection.Vector)  # -> expr("round(x,2)", Length)
division = Division(A=semirigidconnection.Vector, B=scale)
mesh = Mesh(semirigidconnection.Mesh)
vdis = VectorDisplay(Anchor=semirigidconnection.Points, Vector=division)
move = Move(Geometry=semirigidconnection.Points, Motion=division)  # -> Geometry, Transform
medges = MeshEdges(Mesh=mesh)  # -> NakedEdges, InteriorEdges, NonManifoldEdges
ma = MassAddition(Input=vlen)  # -> Result, PartialResults
sum_of_forces = Panel(ma.Result)
tag = TextTag(Location=move.Geometry, Text=vlen, Colour=ColourSwatch(SwatchColor=RGB(0, 0, 0)))

# ==== cluster ARRANGEFAST
N = ClusterInput()
C = ClusterInput()
N_2 = ClusterInput()
C_2 = ClusterInput()
series = Series(Start=0, Step=N, Count=C)
series_2 = Series(Start=0, Step=N_2, Count=C_2)
G = ClusterInput()
X = UnitX(Factor=series)
Z = UnitZ(Factor=series_2)
move = Move(Geometry=G, Motion=X)  # -> graft(Geometry), Transform
move_2 = Move(Geometry=move.Geometry, Motion=Z)  # -> Geometry, Transform
pt = Point(flatten(move_2.Geometry))
pt_2 = ClusterOutput(pt)
